# Dynamo graph 01_Python_Basics.dyn (Dynamo 0.6.2.10622)

number_slider = DoubleSliderInput(4.354916067, range=0..10)
python_script = Python(number_slider)
# ---------- python_script.python (32 lines) ----------
# Default imports
import clr
clr.AddReference('RevitAPI')
clr.AddReference('RevitAPIUI')
from Autodesk.Revit.DB import *
import Autodesk
import sys
import clr
path = r'C:\Autodesk\Dynamo\Core'
exec_path = r'C:\Autodesk\Dynamo\Core\dll'
sys.path.append(path)
sys.path.append(exec_path)
clr.AddReference('LibGNet')
from Autodesk.LibG import *

import math

#The input to this node will be stored in the IN variable.
input_number = IN

# define a function with the "def" keyword, a name, and arguments
def take_squareroot(number):
	return math.sqrt(number)

# call a function with a name an input argument
squareroot = take_squareroot(input_number)

# normal math operations are supported
by_two = squareroot * 2

#Assign your output to the OUT variable
OUT = by_two
# ----------------------------------------
watch = Watch(python_script)
