# Dynamo graph 02_Python_RefPoint.dyn (Dynamo 0.6.2.14024)

number = DoubleInput(5)
python_script = Python(number)
# ---------- python_script.python (21 lines) ----------
#derived from Nathan Miller's example http://theprovingground.wikidot.com/revit-api-py-curves
# Default imports
import clr
clr.AddReference('RevitAPI')
clr.AddReference('RevitAPIUI')
from Autodesk.Revit.DB import *
import Autodesk
import sys
import clr
path = r'C:\Autodesk\Dynamo\Core'
sys.path.append(path)
clr.AddReference('LibGNet')
from Autodesk.LibG import *
import math

doc = __revit__.ActiveUIDocument.Document
app = __revit__.Application


xyz = XYZ(1, 2, IN)
ref_pt_1 = doc.FamilyCreate.NewReferencePoint(xyz)
# ----------------------------------------
transaction = Transaction(python_script)
watch = Watch(python_script)
