# Dynamo graph 04_Python_Revit_Elemens.dyn (Dynamo 0.6.2.10622)

select_elements = MultipleCurvesBySelection()  # 777 picked in the model
python_script = Python(select_elements)
# ---------- python_script.python (22 lines) ----------
#derived from Peter Nguyen's "generative drop ceiling" project: http://dynamocomputation.blogspot.com/ panguyenuwm@gmail.com

objects = IN

air_vents = []
column = []
light_fixtures = []
other_elements = []


for obj in objects:
	name = obj.Category.Name
	if "Air Terminals" in name:
		air_vents.append( name )
	elif "Column" in name:
		column.append(name)
	elif "Light" and "Fix" in name:
		light_fixtures.append(name)
	else:
		other_elements.append(name)

OUT = air_vents, column, light_fixtures, other_elements
# ----------------------------------------
watch = Watch(python_script)
