# Dynamo graph 05_Python_Revit_Geometry.dyn (Dynamo 0.6.2.10622)

select_elements = MultipleCurvesBySelection()  # 777 picked in the model
python_script = Python(select_elements)
# ---------- python_script.python (37 lines) ----------
#derived from Peter Nguyen's "generative drop ceiling" project: http://dynamocomputation.blogspot.com/ panguyenuwm@gmail.com

import clr
clr.AddReference('RevitAPI')
clr.AddReference('RevitAPIUI')
from Autodesk.Revit.DB import *
import Autodesk
import sys
import clr
path = r'C:\Autodesk\Dynamo\Core'
exec_path = r'C:\Autodesk\Dynamo\Core\dll'
sys.path.append(path)
sys.path.append(exec_path)
clr.AddReference('LibGNet')
from Autodesk.LibG import *

objects = IN

def get_solid( revit_object ):
	elem = revit_object
	 
	#trans = DynTransaction()
	#trans.Start()
	 
	opt = Options()
	geometry_list = elem.get_Geometry(opt)
	
	#trans.Commit()
	
	return geometry_list

all_geometry = []
for obj in objects:
	object_geometry = get_solid(obj)
	all_geometry.extend(object_geometry)

OUT = all_geometry
# ----------------------------------------
watch = Watch(python_script)
watch_3d = Watch3D(python_script)
