# Dynamo graph 06_Python_Revit_Non_Planar_Ceiling.dyn (Dynamo 0.6.2.10622)

string = StringInput("C:\dev\Generative-drop-ceiling\AU_Examples\06_Python_Revit_Non_Planar_Ceiling\surfaces_from_bounding_boxes.py")
read_text_file = FileReader(string)
number = DoubleInput(3)
string_2 = StringInput("C:\dev\Generative-drop-ceiling\AU_Examples\06_Python_Revit_Non_Planar_Ceiling\categorize_elements.py")
read_text_file_2 = FileReader(string_2)
select_elements = MultipleCurvesBySelection()  # 88 picked in the model
python_script_from_string = PythonString(read_text_file_2, select_elements)
watch = Watch(python_script_from_string)
get_from_list = GetFromList(number, watch)
python_script_from_string_2 = PythonString(read_text_file, get_from_list)
watch_2 = Watch(python_script_from_string_2)
string_3 = StringInput("C:\dev\Generative-drop-ceiling\AU_Examples\06_Python_Revit_Non_Planar_Ceiling\overall_geometry_boundingbox.py")
read_text_file_3 = FileReader(string_3)
python_script_from_string_3 = PythonString(read_text_file_3, select_elements)
watch_3 = Watch(python_script_from_string_3)
panel_size = DoubleSliderInput(10, range=0..200)
add_file_name = StringInput("non_planar_surfaces_points.txt")
list = NewList(index0=watch_3, index1=panel_size, index2=python_script_from_string_2, index3=add_file_name)
watch_4 = Watch(list)
string_4 = StringInput("C:\dev\Generative-drop-ceiling\AU_Examples\06_Python_Revit_Non_Planar_Ceiling\drop_ceiling_optimization_v5.py")
read_text_file_4 = FileReader(string_4)
python_script_from_string_4 = PythonString(read_text_file_4, list)
watch_3d = Watch3D(python_script_from_string_4)
python_script = Python(select_elements)
# ---------- python_script.python (37 lines) ----------
#derived from Peter Nguyen's "generative drop ceiling" project: http://dynamocomputation.blogspot.com/ panguyenuwm@gmail.com

import clr
clr.AddReference('RevitAPI')
clr.AddReference('RevitAPIUI')
from Autodesk.Revit.DB import *
import Autodesk
import sys
import clr
path = r'C:\Autodesk\Dynamo\Core'
exec_path = r'C:\Autodesk\Dynamo\Core\dll'
sys.path.append(path)
sys.path.append(exec_path)
clr.AddReference('LibGNet')
from Autodesk.LibG import *

objects = IN

def get_solid( revit_object ):
	elem = revit_object
	 
	trans = DynTransaction()
	trans.Start()
	 
	opt = Options()
	geometry_list = elem.get_Geometry(opt)
	
	trans.Commit()
	
	return geometry_list

all_geometry = []
for obj in objects:
	object_geometry = get_solid(obj)
	all_geometry.extend(object_geometry)

OUT = all_geometry
# ----------------------------------------
draw = ForceDrawNode(python_script_from_string_2, lacing=Longest)
watch_5 = Watch(python_script_from_string_4)
