# Dynamo graph 07_Python_Planar_Ceiling.dyn (Dynamo 0.6.2.10622)

string = StringInput("C:\dev\Generative-drop-ceiling\AU_Examples\07_Python_Planar_Ceiling\Connection_Plates.py")
read_text_file = FileReader(string)
string_2 = StringInput("C:\dev\Generative-drop-ceiling\AU_Examples\07_Python_Planar_Ceiling\make_planar_surfaces_and_tabs.py")
read_text_file_2 = FileReader(string_2)
string_3 = StringInput("C:\dev\Generative-drop-ceiling\AU_Examples\07_Python_Planar_Ceiling\Read_txtfile_for_pointlist.py")
read_text_file_3 = FileReader(string_3)
string_4 = StringInput("C:\dev\Generative-drop-ceiling\AU_Examples\07_Python_Planar_Ceiling\non_planar_surfaces_points.txt")
read_text_file_4 = FileReader(string_4)
python_script_from_string = PythonString(read_text_file_3, read_text_file_4)
watch = Watch(python_script_from_string)
number = DoubleInput(0.666)
output_file_name = StringInput("C:\dev\Generative-drop-ceiling\AU_Examples\07_Python_Planar_Ceiling\planarQuads.txt")
list = NewList(index0=watch, index1=number, index2=output_file_name)
python_script_from_string_2 = PythonString(read_text_file_2, list)
split_list = DeCons(python_script_from_string_2)
first_of_list = First(split_list.out1)
watch_2 = Watch(first_of_list)
list_2 = NewList(index0=watch_2, index1=number)
python_script_from_string_3 = PythonString(read_text_file, list_2)
watch_3 = Watch(python_script_from_string_3)
string_5 = StringInput("C:\\dev\\Generative-drop-ceiling\\AU_Examples\\07_Python_Planar_Ceiling\\connection_tabs.sat")
draw = ForceDrawNode(python_script_from_string_3, lacing=Longest)
watch_3d = Watch3D(draw)
number_2 = DoubleInput(0.333)
number_3 = DoubleInput(0.033)
list_3 = NewList(index0=watch_3d, index1=number_2, index2=number_3)
python_script = Python(list_3)
# ---------- python_script.python (70 lines) ----------
import sys
path = 'C:\\Users\\t_nguyp\\Desktop\\Dynamo\\Release'
sys.path.append(path)
import clr
clr.AddReference('LibGNet')
from Autodesk.LibG import *

from Autodesk.LibG import Point,Line,Surface,Polygon,Geometry,Vector

#The input to this node will be stored in the IN variable.
dataEnteringNode = IN

reference_surfaces = IN[0]
tab_height = IN[1]
screw_holes_radius = IN[2]

def vector_create( point_to , point_from ):
   
    vec_x = (point_to.x() - point_from.x()) / 2 
    vec_y = (point_to.y() - point_from.y()) / 2 
    vec_z = (point_to.z() - point_from.z()) / 2 
    
    final_vec = Vector.from_xyz( vec_x, vec_y, vec_z )
    
    return final_vec
    
def move_point_byvector( point, vector, magnitude ):
    vector_copy = Vector.by_coordinates(vector.x(),vector.y(),vector.z())
    vector_copy.normalize()
       
    newpoint = [0,0,0]
    newpoint[0] = point.x() + (vector_copy.x() * magnitude)
    newpoint[1] = point.y() + (vector_copy.y() * magnitude)
    newpoint[2] = point.z() + (vector_copy.z() * magnitude)
    
    finalpt = Point.by_coordinates(newpoint[0], newpoint[1], newpoint[2])
    return finalpt

def find_mid_point( point_1, Point_2):
	
	x = ( point_1.x() + Point_2.x() ) / 2
	y = ( point_1.y() + Point_2.y() ) / 2
	z = ( point_1.z() + Point_2.z() ) / 2
	midpoint = Point.by_coordinates(x,y,z)
	return midpoint

def create_hole( object, point, hole_radius ):
	cutting_sphere = Sphere.by_center_radius (point, hole_radius)
	final_solid = object.subtract_from(cutting_sphere) 
		
	return final_solid[0]

###MAIN###
debug_srf = []
for surface in reference_surfaces:
	test = surface.vertices()
	#norm = surface.normal_at_parameter (0.5, 0.5)
	vec = vector_create( test[2] , test[1] )
	midpoint = find_mid_point( test[2] , test[3] )
	tab_point = move_point_byvector( midpoint, vec, tab_height )
	
	plate =  Polygon.by_points(PointList([test[0],test[1],test[2], tab_point, test[3]])) 
	
	wire_hanging_hole = find_mid_point( midpoint, tab_point )
	debug_srf.append( create_hole( plate, wire_hanging_hole, screw_holes_radius ))
	
	
	
#Assign your output to the OUT variable
OUT = debug_srf #test[1],test[2],surface
# ----------------------------------------
draw_2 = ForceDrawNode(python_script, lacing=Longest)
watch_3d_2 = Watch3D(draw_2)
export_to_sat = ExportSATNode(string_5, watch_3d_2, lacing=Longest)
output_file_name_2 = StringInput("C:\\dev\\Generative-drop-ceiling\\AU_Examples\\07_Python_Planar_Ceiling\\planar_ceiling_pannels.sat")
watch_4 = Watch(split_list.out0)
draw_3 = ForceDrawNode(watch_4, lacing=Longest)
watch_3d_3 = Watch3D(draw_3)
export_to_sat_2 = ExportSATNode(output_file_name_2, watch_3d_3, lacing=Longest)
watch_5 = Watch(python_script)
python_script_2 = Python(number_3)
# ---------- python_script_2.python (6 lines) ----------
#The input to this node will be stored in the IN variable.
dataEnteringNode = IN

num = IN/12
#Assign your output to the OUT variable
OUT = num
# ----------------------------------------
watch_6 = Watch(python_script_2)
watch_7 = Watch(python_script_from_string_2)
watch_8 = Watch(python_script_from_string_2)
watch_9 = Watch(draw_2)
watch_10 = Watch(python_script_from_string_2)
