# Dynamo graph 09_Python_Boolean.dyn (Dynamo 0.6.2.29585)

string = StringInput("C:\dev\Generative-drop-ceiling\AU_Examples\08_Python_Boolean\porus_light_cone_subtraction.py")
read_text_file = FileReader(string)
string_2 = StringInput("C:\dev\Generative-drop-ceiling\AU_Examples\08_Python_Boolean\Read_txtfile_from_pointlist_to_bsplinesurface.py")
read_text_file_2 = FileReader(string_2)
string_3 = StringInput("C:\dev\Generative-drop-ceiling\AU_Examples\08_Python_Boolean\planarQuads.txt")
read_text_file_3 = FileReader(string_3)
python_script_from_string = PythonString(read_text_file_2, read_text_file_3)
flatten_completely = FlattenList(python_script_from_string)
string_4 = StringInput("C:\dev\Generative-drop-ceiling\AU_Examples\08_Python_Boolean\get_geometry_transaction_test.py")
read_text_file_4 = FileReader(string_4)
number = DoubleInput(2)
string_5 = StringInput("C:\dev\Generative-drop-ceiling\AU_Examples\08_Python_Boolean\revit_geometry_sorter.py")
read_text_file_5 = FileReader(string_5)
lighting_elements = MultipleCurvesBySelection()  # 234 picked in the model
python_script_from_string_2 = PythonString(read_text_file_5, lighting_elements)
get_from_list = GetFromList(number, python_script_from_string_2)
watch = Watch(get_from_list)
number_2 = DoubleInput(12)
list = NewList(index0=watch, index1=number_2)
python_script_from_string_3 = PythonString(read_text_file_4, list)
draw = ForceDrawNode(python_script_from_string_3, lacing=Longest)
string_6 = StringInput("C:\dev\Generative-drop-ceiling\AU_Examples\08_Python_Boolean\planar_ceiling_pannels.sat")
import_sat = ImportSATNode(string_6, lacing=Longest)
list_2 = NewList(index0=flatten_completely, index1=draw, index2=import_sat)
python_script_from_string_4 = PythonString(read_text_file, list_2)
watch_2 = Watch(python_script_from_string_4)
python_script = Python()
# ---------- python_script.python (79 lines) ----------
import System
from System import *
import math
import sys
path = 'C:\\Users\\t_nguyp\\Desktop\\Dynamo\\Release'
sys.path.append(path)
import clr
clr.AddReference('LibGNet')
from Autodesk.LibG import *

from Autodesk.LibG import Point,Line,Surface,Polygon,Geometry,Vector,Solid
#The input to this node will be stored in the IN variable.
dataEnteringNode = IN


def length(v):
  return math.sqrt(v.dot(v))

def vector_angle(v1, v2):
	radians = math.acos(v1.dot(v2) / (length(v1) * length(v2)))
	return (radians * 180)/ math.pi
  
def vector_create( point_to , point_from ):
   
    vec_x = (point_to.x() - point_from.x()) / 2 
    vec_y = (point_to.y() - point_from.y()) / 2 
    vec_z = (point_to.z() - point_from.z()) / 2 
    
    final_vec = Vector.from_xyz( vec_x, vec_y, vec_z )
    
    return final_vec
    
def move_point_byvector( point, vector, magnitude ):
    vector_copy = Vector.by_coordinates(vector.x(),vector.y(),vector.z())
    vector_copy.normalize()
       
    newpoint = [0,0,0]
    newpoint[0] = point.x() + (vector_copy.x() * magnitude)
    newpoint[1] = point.y() + (vector_copy.y() * magnitude)
    newpoint[2] = point.z() + (vector_copy.z() * magnitude)
    
    finalpt = Point.by_coordinates(newpoint[0], newpoint[1], newpoint[2])
    return finalpt


surface_points = IN[0]
light = IN[1]
solids = IN[2]
tolerence = 200

"""
for surface in Surfaces:
	for i in range(8):
		rand_num1 = (rand.Next(125, 875))/1000.0
		rand_num2 = (rand.Next(125, 875))/1000.0
		
		test.append(surface.point_at_parameter( rand_num1, rand_num2 ))
"""

objs = []
for point in surface_points:
	test_point = Point.by_coordinates(point.x(),point.y(),light.z())
	dist = test_point.distance_to(light)
	
	if dist >= tolerence:
		continue
		
	lower_pt = Point.by_coordinates(light.x(), light.y(), light.z() - 1)
	Zcomparision_vector = vector_create( lower_pt , light )
	vec = vector_create( point, light )
	angle = vector_angle(vec, Zcomparision_vector)
	
	if angle <= 60:
		new_point = move_point_byvector( point, vec, 10 )
		objs.append(Cone.by_points_radius( light , new_point, 0.1, 3.0))

#Assign your output to the OUT variable

OUT = objs
# ----------------------------------------
python_script_2 = Python()
# ---------- python_script_2.python (11 lines) ----------
#The input to this node will be stored in the IN variable.
dataEnteringNode = IN
surfaces = IN

points = []
for surf in surfaces:
	points.append( surf.point_at_parameter( 0.5, 0.5 ) )
	
	
#Assign your output to the OUT variable
OUT = points
# ----------------------------------------
watch_3 = Watch()
watch_4 = Watch(python_script_from_string_2)
string_7 = StringInput("C:\\dev\\Generative-drop-ceiling\\AU_Examples\08_Python_Boolean\\final_panel.sat")
draw_2 = ForceDrawNode(python_script_from_string_4, lacing=Longest)
watch_3d = Watch3D(draw_2)
export_to_sat = ExportSATNode(string_7, watch_3d, lacing=Longest)
watch_5 = Watch(python_script_from_string)
watch_6 = Watch(python_script_from_string_4)
watch_7 = Watch(python_script_from_string_3)
