# Dynamo graph REVIT_Read_text_and_Planar_Quads.dyn

file_path = StringFilename("C:\dev\Generative-drop-ceiling\Exported_TxtFiles\Test_Point_list2.txt")
read_text_file = FileReader(file_path)
watch = Watch(read_text_file)
file_path_2 = StringFilename("C:\dev\Generative-drop-ceiling\Python\Planar_quads_Intersect_geometry.py")
read_text_file_2 = FileReader(file_path_2)
file_path_3 = StringFilename("C:\dev\Generative-drop-ceiling\Python\Read_txtfile_for_pointlist.py")
read_text_file_3 = FileReader(file_path_3)
python_script_from_string = PythonString(read_text_file_3, read_text_file)
watch_2 = Watch(python_script_from_string)
python_script_from_string_2 = PythonString(read_text_file_2, watch_2)
watch_3 = Watch(python_script_from_string_2)
draw = ForceDrawNode(watch_3, lacing=Longest)
watch_3d = Watch3D(draw)
string = StringInput("mitered_edges.sat")
export_to_sat = ExportSATNode(string, lacing=Longest)
draw_2 = ForceDrawNode(lacing=Longest)
watch_3d_2 = Watch3D(draw_2)
python_script = Python()
# ---------- python_script.python (23 lines) ----------
import sys
path = 'C:\\dev\\Dynamo\\bin\\Release'
sys.path.append(path)
import clr
clr.AddReference('LibGNet')
from Autodesk.LibG import *

from Autodesk.LibG import Point,Line,Surface,Polygon,Geometry,Vector
#The input to this node will be stored in the IN variable.
dataEnteringNode = IN

grid = IN
test = []

polygon_list = [ [ (y,x) for y in range( len(grid[0])-1) ] for x in range( len(grid)-1  ) ]
for i in range(len(grid)-1 ):
     for j in range(len(grid[0])-1 ):
         new_polygon_pointlist = PointList([grid[i][j], grid[i+1][j], grid[i+1][j+1], grid[i][j+1]])
         polygon_list[i][j] = Polygon.by_points(new_polygon_pointlist)
         test.append(polygon_list[i][j])
         
#Assign your output to the OUT variable
OUT = test#polygon_list
# ----------------------------------------
watch_4 = Watch(python_script)
select_elements = MultipleCurvesBySelection()  # 776 picked in the model
extract_solid_from_element = ElementSolid(select_elements, lacing=Longest)
