# Dynamo graph Read_text_and_Planar_Quads_v2.dyn

python_script = Python()
# ---------- python_script.python (140 lines) ----------
import sys
path = 'C:\\Users\\t_nguyp\\Desktop\\Dynamo\\Release'
sys.path.append(path)
import clr
clr.AddReference('LibGNet')
from Autodesk.LibG import *

from Autodesk.LibG import Point,Line,Surface,Polygon,Geometry,Vector

#The input to this node will be stored in the IN variable.
dataEnteringNode = IN
polygon_list = IN[0]

def move_point_byvector( point, vector, magnitude ):
    vector_copy = Vector.by_coordinates(vector.x(),vector.y(),vector.z())
    vector_copy.normalize()
       
    newpoint = [0,0,0]
    newpoint[0] = point.x() + (vector_copy.x() * magnitude)
    newpoint[1] = point.y() + (vector_copy.y() * magnitude)
    newpoint[2] = point.z() + (vector_copy.z() * magnitude)
    
    finalpt = Point.by_coordinates(newpoint[0], newpoint[1], newpoint[2])
    return finalpt

def add_two_vectors( vector_1,vector_2 ):
    vector_1.normalize()
    vector_2.normalize()
    
    vec_x = (vector_1.x() + vector_2.x()) / 2 
    vec_y = (vector_1.y() + vector_2.y()) / 2 
    vec_z = (vector_1.z() + vector_2.z()) / 2 
    
    final_vec = Vector.from_xyz( vec_x, vec_y, vec_z )
    
    return final_vec
            
def create_connection_plate( Point_A, Point_B, vector, setback):
    
    curve = Line.by_start_point_end_point (Point_A, Point_B)
    dist = curve.length ()
    pt1 = curve.point_at_distance (setback)
    pt2 = curve.point_at_distance (dist - setback)
    
    v1 = move_point_byvector( pt1, vector, -plate_protrusion ) #-
    v2 = move_point_byvector( pt2, vector, -plate_protrusion ) #-
    v3 = move_point_byvector( pt2, vector, panel_thickness ) #+ The 1 is for  the hanger? do we need it? 
    v4 = move_point_byvector( pt1, vector, panel_thickness ) #+
    
    Surface = Polygon.by_points( PointList([v1,v2,v3,v4]) )
    return Surface

def check_if_plate_exist( new_plate, exisitng_plates ):
	boolean = False
	centroid_1 = new_plate.point_at_parameter( 0.5,0.5 )
	
	if existing_plates:
		for plate in existing_plates:
			centroid_2 = plate.point_at_parameter( 0.5,0.5 )
			dist = centroid_1.distance_to(centroid_2)
			if dist < .5:
				boolean = True
			
	return boolean
	
def intersect_plane_to_solid( polygons, point_indexs, panel_thickness ):
    i = point_indexs[0]
    j = point_indexs[1]
    
    poly_points = polygons[i][j].vertices()
    center_norm = polygons[i][j].normal_at_parameter (0.5, 0.5)
    
    plates = []
    #points = []
    #poly1
    if j-1 >= 0: 
        adjacent_norm = polygons[i][j-1].normal_at_parameter (0.5, 0.5)
		
        edge_normal = add_two_vectors( center_norm, adjacent_norm )
        vertical_point = move_point_byvector(poly_points[1], edge_normal, 10 )
        test_plate = create_connection_plate( poly_points[0], poly_points[1], edge_normal, setback)
        check = check_if_plate_exist( test_plate, existing_plates )
        if check == False:
			plates.append(test_plate)
    
    #poly2    
    if i+1 <= len(polygons)-1:
        adjacent_norm = polygons[i+1][j].normal_at_parameter (0.5, 0.5)
        
        edge_normal = add_two_vectors( center_norm, adjacent_norm )
        vertical_point = move_point_byvector(poly_points[2], edge_normal, 10 )
        test_plate = create_connection_plate( poly_points[1], poly_points[2], edge_normal, setback)
        check = check_if_plate_exist( test_plate, existing_plates )
        if check == False:
        	plates.append(test_plate)
    
    #poly3 
    if j+1 <= len(polygons[0])-1:
        adjacent_norm = polygons[i][j+1].normal_at_parameter (0.5, 0.5)
        
        edge_normal = add_two_vectors( center_norm, adjacent_norm )
        vertical_point = move_point_byvector(poly_points[3], edge_normal, 10 )
        test_plate = create_connection_plate( poly_points[2], poly_points[3], edge_normal, setback)
        check = check_if_plate_exist( test_plate, existing_plates )
        if check == False:
        	plates.append(test_plate)
        
    #poly4 
    if i-1 >= 0:
        adjacent_norm = polygons[i-1][j].normal_at_parameter (0.5, 0.5)
		
        edge_normal = add_two_vectors( center_norm, adjacent_norm )
        vertical_point = move_point_byvector(poly_points[0], edge_normal, 10 )
        test_plate = create_connection_plate( poly_points[3], poly_points[0], edge_normal, setback)
        check = check_if_plate_exist( test_plate, existing_plates )
        if check == False:
        	plates.append(test_plate)
    
    return plates

####Main####
panel_thickness = IN[1] /12 #for DYNAMO SANDBOX  # for REVIT FEET 0.166

#plate specific variables
plate_protrusion = 0.25 # how much the plate pops out // look at DEF create_connection_plate
setback = 1 # shortens the plate to avoid conflict at corners
existing_plates = []


#debug_plates = []
#create new grid of points that are correctly offset from the original pointlist.
for i in range(len(polygon_list)):
    for j in range(len(polygon_list[0])):
       #debug_planes.extend( intersect_plane( polygon_list, [i,j] ) )
       result = intersect_plane_to_solid( polygon_list, [i,j], panel_thickness )
       existing_plates.extend(result)
       #debug_plates.extend( result)


OUT = existing_plates #polygon_list# ,debug_planes
# ----------------------------------------
file_path = StringFilename("C:\dev\Generative-drop-ceiling\Python\Connection_Plates.py")
read_text_file = FileReader(file_path)
file_path_2 = StringFilename("C:\dev\Generative-drop-ceiling\Python\Planar_quads_Intersect_geometry_Debugging_peter.py")
read_text_file_2 = FileReader(file_path_2)
file_path_3 = StringFilename("C:\dev\Generative-drop-ceiling\Python\Read_txtfile_for_pointlist.py")
read_text_file_3 = FileReader(file_path_3)
file_path_4 = StringFilename("C:\dev\Generative-drop-ceiling\Exported_TxtFiles\Test.txt")
read_text_file_4 = FileReader(file_path_4)
python_script_from_string = PythonString(read_text_file_3, read_text_file_4)
watch = Watch(python_script_from_string)
number = DoubleInput(0.666)
output_file_name = StringInput("C:\dev\Generative-drop-ceiling\maple_mockup\planarQuad_test.txt")
list = NewList(index0=watch, index1=number, index2=output_file_name)
python_script_from_string_2 = PythonString(read_text_file_2, list)
split_list = DeCons(python_script_from_string_2)
first_of_list = First(split_list.out1)
watch_2 = Watch(first_of_list)
list_2 = NewList(index0=watch_2, index1=number)
python_script_from_string_3 = PythonString(read_text_file, list_2)
watch_3 = Watch(python_script_from_string_3)
string = StringInput("C:\dev\Generative-drop-ceiling\maple_mockup\connection_test.sat")
draw = ForceDrawNode(python_script_from_string_3, lacing=Longest)
watch_3d = Watch3D(draw)
number_2 = DoubleInput(0.333)
number_3 = DoubleInput(0.03333)
list_3 = NewList(index0=watch_3d, index1=number_2, index2=number_3)
python_script_2 = Python(list_3)
# ---------- python_script_2.python (70 lines) ----------
import sys
path = 'C:\\Users\\t_nguyp\\Desktop\\Dynamo\\Release'
sys.path.append(path)
import clr
clr.AddReference('LibGNet')
from Autodesk.LibG import *

from Autodesk.LibG import Point,Line,Surface,Polygon,Geometry,Vector

#The input to this node will be stored in the IN variable.
dataEnteringNode = IN

reference_surfaces = IN[0]
tab_height = IN[1]
screw_holes_radius = IN[2]

def vector_create( point_to , point_from ):
   
    vec_x = (point_to.x() - point_from.x()) / 2 
    vec_y = (point_to.y() - point_from.y()) / 2 
    vec_z = (point_to.z() - point_from.z()) / 2 
    
    final_vec = Vector.from_xyz( vec_x, vec_y, vec_z )
    
    return final_vec
    
def move_point_byvector( point, vector, magnitude ):
    vector_copy = Vector.by_coordinates(vector.x(),vector.y(),vector.z())
    vector_copy.normalize()
       
    newpoint = [0,0,0]
    newpoint[0] = point.x() + (vector_copy.x() * magnitude)
    newpoint[1] = point.y() + (vector_copy.y() * magnitude)
    newpoint[2] = point.z() + (vector_copy.z() * magnitude)
    
    finalpt = Point.by_coordinates(newpoint[0], newpoint[1], newpoint[2])
    return finalpt

def find_mid_point( point_1, Point_2):
	
	x = ( point_1.x() + Point_2.x() ) / 2
	y = ( point_1.y() + Point_2.y() ) / 2
	z = ( point_1.z() + Point_2.z() ) / 2
	midpoint = Point.by_coordinates(x,y,z)
	return midpoint

def create_hole( object, point, hole_radius ):
	cutting_sphere = Sphere.by_center_radius (point, hole_radius)
	final_solid = object.subtract_from(cutting_sphere) 
		
	return final_solid[0]

###MAIN###
debug_srf = []
for surface in reference_surfaces:
	test = surface.vertices()
	#norm = surface.normal_at_parameter (0.5, 0.5)
	vec = vector_create( test[2] , test[1] )
	midpoint = find_mid_point( test[2] , test[3] )
	tab_point = move_point_byvector( midpoint, vec, tab_height )
	
	plate =  Polygon.by_points(PointList([test[0],test[1],test[2], tab_point, test[3]])) 
	
	wire_hanging_hole = find_mid_point( midpoint, tab_point )
	debug_srf.append( create_hole( plate, wire_hanging_hole, screw_holes_radius ))
	
	
	
#Assign your output to the OUT variable
OUT = debug_srf #test[1],test[2],surface
# ----------------------------------------
draw_2 = ForceDrawNode(python_script_2, lacing=Longest)
watch_3d_2 = Watch3D(draw_2)
export_to_sat = ExportSATNode(string, watch_3d_2, lacing=Longest)
output_file_name_2 = StringInput("C:\dev\Generative-drop-ceiling\maple_mockup\planar_test.sat")
watch_4 = Watch(split_list.out0)
draw_3 = ForceDrawNode(watch_4, lacing=Longest)
watch_3d_3 = Watch3D(draw_3)
export_to_sat_2 = ExportSATNode(output_file_name_2, watch_3d_3, lacing=Longest)
watch_5 = Watch(python_script_2)
python_script_3 = Python(number_3)
# ---------- python_script_3.python (6 lines) ----------
#The input to this node will be stored in the IN variable.
dataEnteringNode = IN

num = IN/12
#Assign your output to the OUT variable
OUT = num
# ----------------------------------------
watch_6 = Watch(python_script_3)
flatten_completely = FlattenList()
watch_7 = Watch(flatten_completely)
python_script_4 = Python(watch_7)
# ---------- python_script_4.python (68 lines) ----------
import sys
path = 'C:\\Users\\t_nguyp\\Desktop\\Dynamo\\Release'
sys.path.append(path)
import clr
clr.AddReference('LibGNet')
from Autodesk.LibG import *

from Autodesk.LibG import Point,Line,Surface,Polygon,Geometry,Vector

#The input to this node will be stored in the IN variable.
dataEnteringNode = IN
polygonlist = IN

def move_point_byvector( point, vector, magnitude ):
    vector_copy = Vector.by_coordinates(vector.x(),vector.y(),vector.z())
    vector_copy.normalize()
       
    newpoint = [0,0,0]
    newpoint[0] = point.x() + (vector_copy.x() * magnitude)
    newpoint[1] = point.y() + (vector_copy.y() * magnitude)
    newpoint[2] = point.z() + (vector_copy.z() * magnitude)
    
    finalpt = Point.by_coordinates(newpoint[0], newpoint[1], newpoint[2])
    return finalpt

def vector_create( point_to , point_from ):
   
    vec_x = (point_to.x() - point_from.x()) / 2 
    vec_y = (point_to.y() - point_from.y()) / 2 
    vec_z = (point_to.z() - point_from.z()) / 2 
    
    final_vec = Vector.from_xyz( vec_x, vec_y, vec_z )
    
    return final_vec

def create_hole( object, point, hole_radius ):
	cutting_sphere = Sphere.by_center_radius (point, hole_radius)
	final_solid = object.subtract_from(cutting_sphere) 
		
	return final_solid[0]

vertices = []
final_srfs = []

for i in range(len(polygonlist)):
	poly_vertices = polygonlist[i].vertices ()
	norm = polygonlist[i].normal_at_parameter ( 0.5, 0.5 )
	for vert in poly_vertices:
		vertices.append(vert)
	vertices.extend( [vertices[0], vertices[1]] )
	
	dev_surface = polygonlist[i]
	for j in range(4):
		vec = vector_create( vertices[j+2] , vertices[j+1] )
		line = Line.by_start_point_end_point(vertices[j], vertices[j+1])
		holeA = line.point_at_parameter (0.25)
		holeB = line.point_at_parameter (0.75)
		holeA_moved = move_point_byvector( holeA, vec, 0.333 )
		holeB_moved = move_point_byvector( holeB, vec, 0.333 )
		dev_surface = create_hole( dev_surface, holeA_moved, 0.0333 )
		dev_surface = create_hole( dev_surface, holeB_moved, 0.0333 )
	
	dev_surface = dev_surface.thicken(0.125)
	final_srfs.append(dev_surface)
	vertices = []
	
#Assign your output to the OUT variable
OUT = final_srfs
# ----------------------------------------
watch_8 = Watch(python_script_4)
draw_4 = ForceDrawNode(python_script_4, lacing=Longest)
watch_3d_4 = Watch3D(draw_4)
watch_9 = Watch(python_script_from_string_2)
string_2 = StringInput("C:\dev\Generative-drop-ceiling\Python\Read_txtfile_for_pointlist")
string_3 = StringInput("C:\dev\Generative-drop-ceiling\Exported_TxtFiles\planarQuad_textfile5")
string_4 = StringInput("C:\dev\Generative-drop-ceiling\Python\Planar_quads_Intersect_geometry_Debugging_peter")
string_5 = StringInput("C:\dev\Generative-drop-ceiling\Python\Connection_Plates")
