# Dynamo graph Revit_subtract_light_cones.dyn

draw = ForceDrawNode(lacing=Longest)
python_script = Python()
# ---------- python_script.python (22 lines) ----------
import System
from System import *

#The input to this node will be stored in the IN variable.
dataEnteringNode = IN

Surfaces = IN
rand = Random()
rand_num = (rand.Next() % 1000000) / 1000000.0
test =[]

	
for surface in Surfaces:
	for i in range(8):
		rand_num1 = (rand.Next(125, 875))/1000.0
		rand_num2 = (rand.Next(125, 875))/1000.0
		
		test.append(surface.point_at_parameter( rand_num1, rand_num2 ))


#Assign your output to the OUT variable
OUT = test
# ----------------------------------------
watch = Watch(python_script)
file_path = StringFilename("C:\dev\Generative-drop-ceiling\Python\porus_light_cone_subtraction.py")
read_text_file = FileReader(file_path)
file_path_2 = StringFilename("C:\dev\Generative-drop-ceiling\Python\Read_txtfile_from_pointlist_to_bsplinesurface.py")
read_text_file_2 = FileReader(file_path_2)
file_path_3 = StringFilename("C:\dev\Generative-drop-ceiling\Exported_TxtFiles\planarQuad_textfile5.txt")
read_text_file_3 = FileReader(file_path_3)
python_script_from_string = PythonString(read_text_file_2, read_text_file_3)
flatten_completely = FlattenList(python_script_from_string)
file_path_4 = StringFilename("C:\dev\Generative-drop-ceiling\Python\get_geometry_transaction_test.py")
read_text_file_4 = FileReader(file_path_4)
number = DoubleInput(2)
file_path_5 = StringFilename("C:\dev\Generative-drop-ceiling\Python\revit_geometry_sorter.py")
read_text_file_5 = FileReader(file_path_5)
select_elements = MultipleCurvesBySelection()  # 10 picked in the model
python_script_from_string_2 = PythonString(read_text_file_5, select_elements)
get_from_list = GetFromList(number, python_script_from_string_2)
watch_2 = Watch(get_from_list)
python_script_from_string_3 = PythonString(read_text_file_4, watch_2)
python_script_2 = Python(python_script_from_string_3)
# ---------- python_script_2.python (11 lines) ----------
#The input to this node will be stored in the IN variable.
dataEnteringNode = IN
surfaces = IN

points = []
for surf in surfaces:
	points.append( surf.point_at_parameter( 0.5, 0.5 ) )
	
	
#Assign your output to the OUT variable
OUT = points
# ----------------------------------------
draw_2 = ForceDrawNode(python_script_2, lacing=Longest)
file_path_6 = StringFilename("C:\dev\Generative-drop-ceiling\Final_mockup\Ceiling_pattern_test3.sat")
import_sat = ImportSATNode(file_path_6, lacing=Longest)
list = NewList(index0=flatten_completely, index1=draw_2, index2=import_sat)
python_script_from_string_4 = PythonString(read_text_file, list)
watch_3 = Watch(python_script_from_string_4)
number_2 = DoubleInput(0)
python_script_3 = Python()
# ---------- python_script_3.python (40 lines) ----------
import math
import sys
path = 'C:\\Users\\t_nguyp\\Desktop\\Dynamo\\Release'
sys.path.append(path)
import clr
clr.AddReference('LibGNet')
from Autodesk.LibG import *

from Autodesk.LibG import Point,Line,Surface,Polygon,Geometry,Vector,Solid
#The input to this node will be stored in the IN variable.
dataEnteringNode = IN

def length(v):
  return math.sqrt(v.dot(v))

def angle(v1, v2):
	radians = math.acos(v1.dot(v2) / (length(v1) * length(v2)))
	return (radians * 180)/ math.pi
	
def vector_create( point_to , point_from ):
   
    vec_x = (point_to.x() - point_from.x()) / 2 
    vec_y = (point_to.y() - point_from.y()) / 2 
    vec_z = (point_to.z() - point_from.z()) / 2 
    
    final_vec = Vector.from_xyz( vec_x, vec_y, vec_z )
    
    return final_vec

pt1 = Point.by_coordinates(0.0,0.0,0.0)
pt2 = Point.by_coordinates(0.0,10.0,0.0)
pt3 = Point.by_coordinates(-10.0,-10.0,0.0)

vec1 = vector_create( pt2 , pt1 )
vec2 = vector_create( pt3 , pt1 )

angle = angle(vec1, vec2)

#Assign your output to the OUT variable
OUT = angle
# ----------------------------------------
watch_4 = Watch(python_script_3)
python_script_4 = Python()
# ---------- python_script_4.python (79 lines) ----------
import System
from System import *
import math
import sys
path = 'C:\\Users\\t_nguyp\\Desktop\\Dynamo\\Release'
sys.path.append(path)
import clr
clr.AddReference('LibGNet')
from Autodesk.LibG import *

from Autodesk.LibG import Point,Line,Surface,Polygon,Geometry,Vector,Solid
#The input to this node will be stored in the IN variable.
dataEnteringNode = IN


def length(v):
  return math.sqrt(v.dot(v))

def vector_angle(v1, v2):
	radians = math.acos(v1.dot(v2) / (length(v1) * length(v2)))
	return (radians * 180)/ math.pi
  
def vector_create( point_to , point_from ):
   
    vec_x = (point_to.x() - point_from.x()) / 2 
    vec_y = (point_to.y() - point_from.y()) / 2 
    vec_z = (point_to.z() - point_from.z()) / 2 
    
    final_vec = Vector.from_xyz( vec_x, vec_y, vec_z )
    
    return final_vec
    
def move_point_byvector( point, vector, magnitude ):
    vector_copy = Vector.by_coordinates(vector.x(),vector.y(),vector.z())
    vector_copy.normalize()
       
    newpoint = [0,0,0]
    newpoint[0] = point.x() + (vector_copy.x() * magnitude)
    newpoint[1] = point.y() + (vector_copy.y() * magnitude)
    newpoint[2] = point.z() + (vector_copy.z() * magnitude)
    
    finalpt = Point.by_coordinates(newpoint[0], newpoint[1], newpoint[2])
    return finalpt


surface_points = IN[0]
light = IN[1]
solids = IN[2]
tolerence = 200

"""
for surface in Surfaces:
	for i in range(8):
		rand_num1 = (rand.Next(125, 875))/1000.0
		rand_num2 = (rand.Next(125, 875))/1000.0
		
		test.append(surface.point_at_parameter( rand_num1, rand_num2 ))
"""

objs = []
for point in surface_points:
	test_point = Point.by_coordinates(point.x(),point.y(),light.z())
	dist = test_point.distance_to(light)
	
	if dist >= tolerence:
		continue
		
	lower_pt = Point.by_coordinates(light.x(), light.y(), light.z() - 1)
	Zcomparision_vector = vector_create( lower_pt , light )
	vec = vector_create( point, light )
	angle = vector_angle(vec, Zcomparision_vector)
	
	if angle <= 60:
		new_point = move_point_byvector( point, vec, 10 )
		objs.append(Cone.by_points_radius( light , new_point, 0.1, 3.0))

#Assign your output to the OUT variable

OUT = objs
# ----------------------------------------
draw_3 = ForceDrawNode(python_script_from_string_4, lacing=Longest)
watch_3d = Watch3D(draw_3)
watch_5 = Watch(python_script_from_string)
number_3 = DoubleInput(0.5)
point_at_uv_parameter = PointAtUVParameterNode(watch_5, number_3, number_3, lacing=Longest)
watch_6 = Watch(point_at_uv_parameter)
number_slider = DoubleSliderInput(362.6436782, range=0..500)
number_slider_2 = DoubleSliderInput(255.8965517, range=0..500)
number_slider_3 = DoubleSliderInput(200, range=0..200)
point = Point3DNode(number_slider, number_slider_2, number_slider_3, lacing=Longest)
number_slider_4 = DoubleSliderInput(173.5358511, range=0..500)
number_slider_5 = DoubleSliderInput(413.047619, range=0..500)
number_slider_6 = DoubleSliderInput(200, range=0..200)
point_2 = Point3DNode(number_slider_4, number_slider_5, number_slider_6, lacing=Longest)
list_2 = NewList(index0=point, index1=point_2)
watch_7 = Watch(python_script_2)
watch_8 = Watch(python_script_from_string_2)
