# Dynamo graph Surface_CeilingOptimization.dyn

file_path = StringFilename("C:\dev\Generative-drop-ceiling\Media\dummymodel2.sat")
import_sat = ImportSATNode(file_path, lacing=Longest)
watch = Watch(import_sat)
python_script = Python()
# ---------- python_script.python (67 lines) ----------
#The input to this node will be stored in the IN variable.
dataEnteringNode = IN

#class is needed for each point? 
	#class info contains the point, and a boolean telling if it is still moveable
class Point_Check:
	def __init__(self, _point):
		self.point = _point
		self.boolean = False 
		
	def closest_geometry( self, geometry_list ):
		old_distance = 50000.0
		#
		for obj in geometry_list:
			closest_point = obj.get_closest_point(self.point)
			distance = closest_point.distance_to(self.point)
			if distance < old_distance:
				old_distance = distance
		
		return old_distance
##########################################################################

xlength = IN[0]
ylength = IN[1]
spacing = IN[2]
reference_geo = IN[3]

x_number = round(xlength/spacing)
y_number = round(ylength/spacing)

newx_spacing = xlength / x_number
newy_spacing = ylength / y_number

#create comprehensive list from [0,0,0] with all z at 0
grid = [ [ (y,x) for y in range( int(y_number)+1) ] for x in range( int(x_number) + 1 ) ]
#create grid spacing based on input and distances.
#grid_points = []
for i in range(int(x_number) + 1):
	for j in range(int(y_number) + 1):
		grid[i][j] = Point_Check(Point.by_coordinates(i*newx_spacing, j*newy_spacing, 50.0))
		#grid_points.append( Point_Check(Point.by_coordinates(i*newx_spacing, j*newy_spacing, 0.0)) )
#then iterate through the points until all the z's are no longer allowed to move.

testpt = []
count = 1

while count > 0:
	count = 0
	#while there are still points.
	for i in range(int(x_number) + 1):
		for j in range(int(y_number) + 1):
			if grid[i][j].boolean == False:
				check = grid[i][j].closest_geometry( reference_geo )
				if check < 12:
					grid[i][j].boolean == True
				else:
					grid[i][j].point.set_z( grid[i][j].point.z() + 1)
					count += 1

if count == 0:
	for i in range(int(x_number) ):
		for j in range(int(y_number) ):
			#testpt.append(grid[i][j].point)
			pointlist = PointList([ grid[i][j].point, grid[i+1][j].point, grid[i+1][j+1].point, grid[i][j+1].point ])
			testpt.append( Polygon.by_points( pointlist ) )
#Assign your output to the OUT variable
OUT = testpt #grid_points #grid_points[0].boolean
# ----------------------------------------
python_script_2 = Python()
# ---------- python_script_2.python (24 lines) ----------
#The input to this node will be stored in the IN variable.
dataEnteringNode = IN

reference_geo = IN

def closest_geometry( point, geometry_list ):
	old_distance = 50000.0
	#
	for obj in geometry_list:
		closest_point = point.get_closest_point(obj)
		distance = closest_point.distance_to(point)
		if distance < old_distance:
			old_distance = distance
	
	return old_distance
##################################
#Assign your output to the OUT variable

point = Point.by_coordinates(0,0,0)

#dist = closest_geometry( point, reference_geo )
cpt = reference_geo[0].get_closest_point( point )

OUT = cpt
# ----------------------------------------
watch_2 = Watch()
draw = ForceDrawNode(lacing=Longest)
list = NewList()
number = DoubleInput(0)
point = Point3DNode(lacing=Longest)
python_script_3 = Python()
# ---------- python_script_3.python (66 lines) ----------
#The input to this node will be stored in the IN variable.
dataEnteringNode = IN

#class is needed for each point? 
	#class info contains the point, and a boolean telling if it is still moveable
class Point_Check:
	def __init__(self, _point):
		self.point = _point
		self.boolean = False 
		
	def closest_geometry( self, geometry_list ):
		old_distance = 50000.0
		#
		for obj in geometry_list:
			closest_point = obj.get_closest_point(self.point)
			distance = closest_point.distance_to(self.point)
			if distance < old_distance:
				old_distance = distance
		
		return old_distance
##########################################################################

xlength = IN[0]
ylength = IN[1]
spacing = IN[2]
reference_geo = IN[3]

x_number = round(xlength/spacing)
y_number = round(ylength/spacing)

newx_spacing = xlength / x_number
newy_spacing = ylength / y_number

#create comprehensive list from [0,0,0] with all z at 0
grid = [ [ (y,x) for y in range( int(y_number)+1) ] for x in range( int(x_number) + 1 ) ]
#create grid spacing based on input and distances.
grid_points = []
for i in range(int(x_number) + 1):
	for j in range(int(y_number) + 1):
		#grid[i][j] = Point.by_coordinates(i*newx_spacing, j*newy_spacing, 0.0)
		grid_points.append( Point_Check(Point.by_coordinates(i*newx_spacing, j*newy_spacing, 0.0)) )
#then iterate through the points until all the z's are no longer allowed to move.

testpt = []
count = 1

while count > 0:
	count = 0
	#while there are still points.
	for pt in grid_points:
		if pt.boolean == False:
			check = pt.closest_geometry( reference_geo )
			if check < 12:
				pt.boolean == True
			else:
				pt.point.set_z( pt.point.z() + 1)
				crap = 10
				count += 1
	#check pt with obj 
	#if obj is not within 6 inches then move
if count == 0:
	for pt in grid_points:
		testpt.append(pt.point)

#Assign your output to the OUT variable
OUT = testpt #grid_points #grid_points[0].boolean
# ----------------------------------------
string = StringInput("testgeo_srf")
watch_3 = Watch()
list_2 = NewList(index0=watch_3)
draw_2 = ForceDrawNode(list_2, lacing=Longest)
export_to_sat = ExportSATNode(string, draw_2, lacing=Longest)
draw_3 = ForceDrawNode(lacing=Longest)
reverse = Reverse()
split_pair = DeCons(reverse)
string_2 = StringInput("testgeo_poly")
watch_4 = Watch()
draw_4 = ForceDrawNode(watch_4, lacing=Longest)
export_to_sat_2 = ExportSATNode(string_2, draw_4, lacing=Longest)
string_3 = StringInput("test_txtPoint")
watch_5 = Watch()
string_4 = StringInput("testgeo_surfaces")
export_to_sat_3 = ExportSATNode(string_4, lacing=Longest)
file_path_2 = StringFilename("C:\dev\Generative-drop-ceiling\Python\drop_ceiling_optimization_v5.py")
read_file = FileReader(file_path_2)
number_slider = DoubleSliderInput(722.9009193, range=0..1020)
number_slider_2 = DoubleSliderInput(748.4371808, range=0..1500)
number_slider_3 = DoubleSliderInput(200, range=0..200)
list_3 = NewList(index0=number_slider, index1=number_slider_2, index2=number_slider_3, index3=import_sat)
python_script_from_string = PythonString(read_file, list_3)
watch_6 = Watch(python_script_from_string)
draw_5 = ForceDrawNode(watch_6, lacing=Longest)
watch_3d = Watch3D(draw_5)
