# Dynamo graph Surface_CeilingOptimization_refactor.dyn

file_path = StringFilename("C:\dev\Generative-drop-ceiling\Media\hvac_dummymodel.sat")
import_sat = ImportSATNode(file_path, lacing=Longest)
watch = Watch(import_sat)
file_path_2 = StringFilename("C:\Users\tiernep.ADS\workspace\DropCeiling\geometry_processor.py")
read_file = FileReader(file_path_2)
python_script_from_string = PythonString(read_file, import_sat)
draw = ForceDrawNode(python_script_from_string, lacing=Longest)
watch_2 = Watch(python_script_from_string)
