# Dynamo graph Thicken_surface_planarcuts_TEST.dyn

number = DoubleInput(0)
python_script = Python(number)
# ---------- python_script.python (64 lines) ----------
import sys
path = 'C:\\dev\\Dynamo\\bin\\Release'
sys.path.append(path)
import clr
clr.AddReference('LibGNet')
from Autodesk.LibG import *

from Autodesk.LibG import Point,Line,Surface,Polygon,Geometry
#The input to this node will be stored in the IN variable.
dataEnteringNode = IN

pt1 = Point.by_coordinates( 5.0,0.0,0.0)
pt2 = Point.by_coordinates( 10.0,10.0,10.0)
pt3 = Point.by_coordinates( 1.0,10.0,0.0)

ptlist = PointList([pt1,pt2,pt3])
srf = Polygon.by_points(ptlist)
#plane = []
plane = Plane.by_three_points( pt1,pt2,pt3  )  
pt1 = Point.by_coordinates( 5.0,0.0,0.0)
pt2 = Point.by_coordinates( 10.0,10.0,10.0)
pt3 = Point.by_coordinates( 12.0,10.0,0.0)
ptlist = PointList([pt1,pt2,pt3])
srf = Polygon.by_points(ptlist)
#plane = []
plane2 = Plane.by_three_points( pt1,pt2,pt3  )  
"""
plane.append(Plane.by_three_points( pt1,pt2,pt3  )  )
plane.append(Plane.by_three_points( pt1,pt2,pt3  )  )
plane.append(Plane.by_three_points( pt1,pt2,pt3  ) )


test = None
for normal in plane:
	if test == None:
		test = normal.normal()
		
test.set_x(test.x()*5)
test.set_y(test.y()*15)
test.set_z(test.z()*10)

point = Point.by_coordinates(test.x(),test.y(),test.z())
test.normalize()
point2 = Point.by_coordinates(test.x(),test.y(),test.z())

origin = Point.by_coordinates(0.0,0.0,0.0)
dist = origin.distance_to(point2)

test.set_x(test.x()*5)
test.set_y(test.y()*5)
test.set_z(test.z()*5)
point3 = Point.by_coordinates(test.x(),test.y(),test.z())
#dist = origin.distance_to(point3)
new_point = Point.by_coordinates(5.0,0.0,0.0)


new_point.set_x( new_point.x() + test.x())
new_point.set_y( new_point.y() + test.y())
new_point.set_z( new_point.z() + test.z())
"""

#Assign your output to the OUT variable

OUT = plane, plane2
# ----------------------------------------
watch = Watch(python_script)
number_2 = DoubleInput(0)
python_script_2 = Python(number_2)
# ---------- python_script_2.python (55 lines) ----------
import sys
path = 'C:\\dev\\Dynamo\\bin\\Release'
sys.path.append(path)
import clr
clr.AddReference('LibGNet')
from Autodesk.LibG import *

from Autodesk.LibG import Point,Line,Surface,Polygon,Geometry
#The input to this node will be stored in the IN variable.
dataEnteringNode = IN

def move_point_byvector( point, vector, magnitude ):
    vector_copy = Vector.by_coordinates(vector.x(),vector.y(),vector.z())
    vector_copy.normalize()
       
    newpoint = [0,0,0]
    newpoint[0] = point.x() + (vector_copy.x() * magnitude)
    newpoint[1] = point.y() + (vector_copy.y() * magnitude)
    newpoint[2] = point.z() + (vector_copy.z() * magnitude)
    
    finalpt = Point.by_coordinates(newpoint[0], newpoint[1], newpoint[2])
    return finalpt
    
def enlarge_polygon( polygon ):
	vertex_list = []
	for point in polygon.vertices():
		vertex_list.append(point)
	vertex_list.extend(vertex_list)
	#vector3 newVector = targetPoint - initialPoint;
	point = []
	for i in range(4):
		vectorx = vertex_list[i].x() - vertex_list[i+2].x() 
		vectory = vertex_list[i].y() - vertex_list[i+2].y()
		vectorz = vertex_list[i].z() - vertex_list[i+2].z()
	
		vectest = Vector.from_xyz(vectorx, vectory, vectorz)
		vectest.normalize()
		
		point.append(move_point_byvector( vertex_list[i], vectest, 1 ))
	Ptlist = PointList([ point[0], point[1], point[2], point[3] ])	
	new_polygon = Polygon.by_points(Ptlist)
	return new_polygon

pt1 = Point.by_coordinates(0.0,0.0,0.0)
pt2 = Point.by_coordinates(0.0,10.0,0.0)
pt3 = Point.by_coordinates(10.0,10.0,0.0)
pt4 = Point.by_coordinates(10.0,0.0,0.0)

ptlist = PointList([pt1,pt2,pt3,pt4])
surf = Polygon.by_points(ptlist)
test = surf.thicken (5.0,  False)

test2 = enlarge_polygon( surf )
#Assign your output to the OUT variable
OUT = test
# ----------------------------------------
watch_2 = Watch(python_script_2)
list = NewList(index0=python_script)
draw = ForceDrawNode(list, lacing=Longest)
list_2 = NewList(index0=python_script_2)
draw_2 = ForceDrawNode(list_2, lacing=Longest)
list_3 = NewList(index0=draw, index1=draw_2)
python_script_3 = Python(list_3)
# ---------- python_script_3.python (29 lines) ----------
import sys
path = 'C:\\dev\\Dynamo\\bin\\Release'
sys.path.append(path)
import clr
clr.AddReference('LibGNet')
from Autodesk.LibG import *

from Autodesk.LibG import Point,Line,Surface,Polygon,Geometry,Vector

#The input to this node will be stored in the IN variable.
dataEnteringNode = IN
planes = IN[0]
solid = IN[1][0]

#test = solid.slice_with_plane (plane)
planelist = PlaneList([ planes[0][0],planes[0][1] ])
test = solid.slice_with_planes(planelist,True)

pt1 = Point.by_coordinates(5.0,5.0,0.0)
pt2 = Point.by_coordinates(5.0,5.0,-10.0)
line = Line.by_start_point_end_point(pt1,pt2)

for obj in test:

	check = line.does_intersect(obj)
	if check == True:
		finalobj = obj
#Assign your output to the OUT variable
OUT = finalobj
# ----------------------------------------
watch_3 = Watch(python_script_3)
list_4 = NewList(index0=watch_3)
draw_3 = ForceDrawNode(list_4, lacing=Longest)
watch_3d = Watch3D(draw_3)
watch_3d_2 = Watch3D(draw_2)
python_script_4 = Python(list_4)  # starter script, not edited (OUT = 0)
