# Dynamo graph ceiling_subdivision.dyn

file_path = StringFilename("C:\dev\Generative-drop-ceiling\Python\subdivide_nurbs_without_reference_surface.py")
read_text_file = FileReader(file_path)
file_path_2 = StringFilename("C:\dev\Generative-drop-ceiling\Python\Read_txtfile_from_pointlist_to_polygon.py")
read_text_file_2 = FileReader(file_path_2)
file_path_3 = StringFilename("C:\dev\Generative-drop-ceiling\Media\planarQuad_textfile.txt")
read_text_file_3 = FileReader(file_path_3)
python_script_from_string = PythonString(read_text_file_2, read_text_file_3)
draw = ForceDrawNode(python_script_from_string, lacing=Longest)
watch_3d = Watch3D(draw)
python_script_from_string_2 = PythonString(read_text_file, watch_3d)
watch = Watch(python_script_from_string_2)
draw_2 = ForceDrawNode(python_script_from_string_2, lacing=Longest)
watch_3d_2 = Watch3D(draw_2)
file_path_4 = StringFilename("C:\dev\Generative-drop-ceiling\Media\testgeo_srf")
import_sat = ImportSATNode(lacing=Longest)
watch_2 = Watch(import_sat)
watch_3d_3 = Watch3D(import_sat)
python_script = Python(watch_3d_3)
# ---------- python_script.python (16 lines) ----------
import sys
path = 'C:\\dev\\Dynamo\\bin\\Release'
sys.path.append(path)
import clr
clr.AddReference('LibGNet')
from Autodesk.LibG import *

from Autodesk.LibG import Point,Line,Surface,Polygon,Geometry

#The input to this node will be stored in the IN variable.
dataEnteringNode = IN

srf = IN[0]

#Assign your output to the OUT variable
OUT = srf
# ----------------------------------------
watch_3 = Watch(python_script)
list = NewList(index0=watch_3)
python_script_2 = Python(python_script_from_string)
# ---------- python_script_2.python (37 lines) ----------
import sys
path = 'C:\\dev\\Dynamo\\bin\\Release'
sys.path.append(path)
import clr
clr.AddReference('LibGNet')
from Autodesk.LibG import *

from Autodesk.LibG import Point,Line,Surface,Polygon,Geometry

#The input to this node will be stored in the IN variable.
dataEnteringNode = IN

def corner_points(surf):
	"""
	ptlist = [0, 0, 0, 0]
	ptlist[0] = surf.point_at_parameter(0.0, 0.0)
	ptlist[1] = surf.point_at_parameter(1.0, 0.0)
	ptlist[2] = surf.point_at_parameter(1.0, 1.0)
	ptlist[3] = surf.point_at_parameter(0.0, 1.0)
	
	"""
	polyvert = surf.vertices()
	
	ptlist = []
	for i in range(polyvert.Count):
		ptlist.append(polyvert[i])
	
	
	return ptlist
	
pts = []

for surfaces in IN:
	pts.extend(corner_points(surfaces))

#Assign your output to the OUT variable
OUT = pts
# ----------------------------------------
draw_3 = ForceDrawNode(python_script_2, lacing=Longest)
watch_4 = Watch(draw_3)
watch_3d_4 = Watch3D(watch_4)
file_path_5 = StringFilename("C:\dev\Generative-drop-ceiling\Media\Export_Planar_quads.sat")
import_sat_2 = ImportSATNode(file_path_5, lacing=Longest)
watch_5 = Watch(import_sat_2)
watch_3d_5 = Watch3D(watch_5)
python_script_3 = Python(watch_3d_5)
# ---------- python_script_3.python (7 lines) ----------
#The input to this node will be stored in the IN variable.
dataEnteringNode = IN

input_surfaces = []
input_surfaces.extend(IN)
#Assign your output to the OUT variable
OUT = input_surfaces
# ----------------------------------------
watch_6 = Watch(python_script_3)
watch_7 = Watch(python_script_from_string)
