# Dynamo graph closest_point_test.dyn

file_path = StringFilename("C:\dev\Generative-drop-ceiling\Python\closest_point_test.py")
read_text_file = FileReader(file_path)
number = DoubleInput(0)
python_script_from_string = PythonString(read_text_file, number)
watch = Watch(python_script_from_string)
