# Dynamo graph cull_list_duplicate_test.dyn

number = DoubleInput(0)
python_script = Python(number)
# ---------- python_script.python (41 lines) ----------
import sys
path = 'C:\\dev\\Dynamo\\bin\\Release'
sys.path.append(path)
import clr
clr.AddReference('LibGNet')
from Autodesk.LibG import *

#The input to this node will be stored in the IN variable.
dataEnteringNode = IN

pt1 = []
x = 5

for i in range(5):
	pt1.append(Point.by_coordinates( x * i, 0.0, 0.0))
	

pt2 = pt1[0:2]

pt1.extend(pt2)

def cull_duplicates( object_list ):
    seen = set()
    seen_add = seen.add
    return [ x for x in object_list if x not in seen and not seen_add(x)]
#test = f7([1,1,2,2,3,3,4,4,5,5,6])

test = cull_duplicates(pt1)
"""   
test = pt2
for i in range(len(test)):
	for j in range(len(pt1)):
		if test[i] == pt1[j]:
			continue
		 
		test.append( pt1[j] )
"""
#while test:
#	test.pop()
#Assign your output to the OUT variable
OUT = test
# ----------------------------------------
watch = Watch(python_script)
draw = ForceDrawNode(python_script, lacing=Longest)
