# Dynamo graph from_lightssource_to_points.dyn

file_path = StringFilename("C:\dev\Generative-drop-ceiling\Python\get_geometry_transaction_test.py")
read_text_file = FileReader(file_path)
select_elements = MultipleCurvesBySelection()  # 10 picked in the model
python_script_from_string = PythonString(read_text_file, select_elements)
watch = Watch(python_script_from_string)
python_script = Python(watch)
# ---------- python_script.python (23 lines) ----------
import sys
path = 'C:\\Users\\t_nguyp\\Desktop\\Dynamo\\Release'
sys.path.append(path)
import clr
clr.AddReference('LibGNet')
from Autodesk.LibG import *

from Autodesk.LibG import Point,Line,Surface,Polygon,Geometry,Vector

#The input to this node will be stored in the IN variable.
dataEnteringNode = IN
surfaces = IN
points = []

f = open( "C:\dev\Generative-drop-ceiling\Final_mockup\lightPoints.txt", "w")

for surf in surfaces:
	pt = surf.point_at_parameter ( 0.5, 0.5 )
	f.write( str(pt.x()) + "," + str(pt.y()) + "," + str(pt.z()) )
	f.write("\n")
f.close()
#Assign your output to the OUT variable
OUT = 0
# ----------------------------------------
