# Dynamo graph get_geometry_from_element_test.dyn

file_path = StringFilename("C:\dev\Generative-drop-ceiling\Python\get_geometry_transaction_test_2.py")
read_text_file = FileReader()
python_script_from_string = PythonString(read_text_file)
watch = Watch(python_script_from_string)
file_path_2 = StringFilename("C:\dev\Generative-drop-ceiling\Python\get_geometry_transaction_test.py")
read_text_file_2 = FileReader(file_path_2)
select_model_element = ModelElementSelection()  # 1 picked in the model
python_script_from_string_2 = PythonString(read_text_file_2, select_model_element)
watch_2 = Watch(python_script_from_string_2)
draw = ForceDrawNode(python_script_from_string_2, lacing=Longest)
watch_3d = Watch3D(draw)
number = DoubleInput(0)
python_script = Python(number)
# ---------- python_script.python (15 lines) ----------
import sys
path = 'C:\\dev\\Dynamo\\bin\\Release'
sys.path.append(path)
import clr
clr.AddReference('LibGNet')
from Autodesk.LibG import *

from Autodesk.LibG import Point,Line,Surface,Polygon,Geometry
#The input to this node will be stored in the IN variable.
dataEnteringNode = IN

point = Point.by_coordinates(0.0,19.0,0.0)

#Assign your output to the OUT variable
OUT = point
# ----------------------------------------
watch_3 = Watch(python_script)
list = NewList(index0=watch_3)
draw_2 = ForceDrawNode(list, lacing=Longest)
