# Dynamo graph get_geometry_from_element_testv2.dyn

file_path = StringFilename("C:\dev\Generative-drop-ceiling\Python\get_geometry_transaction_test.py")
read_text_file = FileReader(file_path)
select_elements = MultipleCurvesBySelection()  # 23 picked in the model
python_script_from_string = PythonString(read_text_file, select_elements)
watch = Watch(python_script_from_string)
draw = ForceDrawNode(python_script_from_string, lacing=Longest)
watch_3d = Watch3D(draw)
