# Dynamo graph get_revit_geo_test.dyn

select_model_element = ModelElementSelection()  # 1 picked in the model
watch = Watch(select_model_element)
select_elements = MultipleCurvesBySelection()  # 10 picked in the model
python_script = Python(select_elements)
# ---------- python_script.python (34 lines) ----------
#The input to this node will be stored in the IN variable.
dataEnteringNode = IN
test = []
objects = IN

air_vents = []
standard_geometry = []

def get_solid( revit_object ):
	elem = revit_object
	 
	trans = DynTransaction()
	trans.Start()
	 
	opt = Options()
	geometry_list = elem.get_Geometry(opt)
	
	trans.Commit()
	
	return geometry_list

for obj in objects:
	name = obj.Category.Name
	if name == "Air Terminals":
		air_vents.append( obj )
		solid = get_solid(obj)
	else:
		standard_geometry.append(obj)
	#GetOriginalGeometry(Options())
	#.get_Geometry(Options())


#Assign your output to the OUT variable
OUT = solid
# ----------------------------------------
watch_2 = Watch(python_script)
list = NewList(index0=python_script)
draw = ForceDrawNode(list, lacing=Longest)
watch_3d = Watch3D(draw)
extract_solid_from_element = ElementSolid(select_model_element, lacing=CrossProduct)
watch_3 = Watch(extract_solid_from_element)
