# Dynamo graph make_planar.dyn

file_path = StringFilename("C:\dev\Generative-drop-ceiling\Python\make_planar.py")
read_text_file = FileReader(file_path)
watch = Watch(read_text_file)
number = DoubleInput(0)
file_path_2 = StringFilename("C:\dev\Generative-drop-ceiling\Media\ceiling_column.sat")
import_sat = ImportSATNode(file_path_2, lacing=Longest)
file_path_3 = StringFilename("C:\dev\Generative-drop-ceiling\Media\ceiling_top_surface.sat")
import_sat_2 = ImportSATNode(file_path_3, lacing=Longest)
file_path_4 = StringFilename("C:\dev\Generative-drop-ceiling\Media\ceiling_pipes.sat")
import_sat_3 = ImportSATNode(file_path_4, lacing=Longest)
file_path_5 = StringFilename("C:\dev\Generative-drop-ceiling\Media\ceiling_hvac_supply.sat")
import_sat_4 = ImportSATNode(file_path_5, lacing=Longest)
file_path_6 = StringFilename("C:\dev\Generative-drop-ceiling\Media\ceiling_hvac_return.sat")
import_sat_5 = ImportSATNode(file_path_6, lacing=Longest)
list = NewList(index0=import_sat, index1=import_sat_2, index2=import_sat_3, index3=import_sat_4, index4=import_sat_5)
python_script_from_string = PythonString(read_text_file, list)
get_from_list = GetFromList(number, python_script_from_string, lacing=Longest)
draw = ForceDrawNode(get_from_list, lacing=Longest)
watch_2 = Watch(python_script_from_string)
number_2 = DoubleInput(1)
get_from_list_2 = GetFromList(number_2, python_script_from_string, lacing=Longest)
draw_2 = ForceDrawNode(get_from_list_2, lacing=Longest)
