# Dynamo graph single_panel_articulation.dyn

number_slider = DoubleSliderInput(5.67816092, range=0..7)
python_script = Python()
# ---------- python_script.python (21 lines) ----------
import sys
path = 'C:\\Users\\t_nguyp\\Desktop\\Dynamo\\Release'
sys.path.append(path)
import clr
clr.AddReference('LibGNet')
from Autodesk.LibG import *

from Autodesk.LibG import Point,Line,Surface,Polygon,Geometry,Vector,Solid

#The input to this node will be stored in the IN variable.
dataEnteringNode = IN
obj = IN

surfaces = obj.surfaces ()

point = []
for  surface in surfaces:
	GraphicItem.persist(surface)

#Assign your output to the OUT variable
OUT = surfaces
# ----------------------------------------
watch = Watch(python_script)
get_from_list = GetFromList(number_slider, watch)
list = NewList(index0=get_from_list)
draw = ForceDrawNode(list, lacing=Longest)
watch_3d = Watch3D(draw)
watch_2 = Watch(get_from_list)
python_script_2 = Python(watch_2)
# ---------- python_script_2.python (16 lines) ----------
import sys
path = 'C:\\Users\\t_nguyp\\Desktop\\Dynamo\\Release'
sys.path.append(path)
import clr
clr.AddReference('LibGNet')
from Autodesk.LibG import *

from Autodesk.LibG import Point,Line,Surface,Polygon,Geometry,Vector,Solid

#The input to this node will be stored in the IN variable.
dataEnteringNode = IN
obj = IN

point = obj.point_at_parameter(0.5,0.5)

OUT = point
# ----------------------------------------
watch_3 = Watch(python_script_2)
list_2 = NewList(index0=python_script_2)
draw_2 = ForceDrawNode(list_2, lacing=Longest)
watch_3d_2 = Watch3D(draw_2)
python_script_3 = Python()
# ---------- python_script_3.python (51 lines) ----------
import sys
path = 'C:\\Users\\t_nguyp\\Desktop\\Dynamo\\Release'
sys.path.append(path)
import clr
clr.AddReference('LibGNet')
from Autodesk.LibG import *

from Autodesk.LibG import Point,Line,Surface,Polygon,Geometry,Vector,Solid

#The input to this node will be stored in the IN variable.
dataEnteringNode = IN

solid = IN

solid_surfaces = solid.get_faces ()

surf_centroids = solid_surfaces[2].get_centroid()

srf_area_list = []
for surface in solid_surfaces:
	srf_area_list.append( [surface, surface.get_area()] )

sorted_surfaces = sorted(srf_area_list, key = lambda x: x[1], reverse = True)

clean_list = []
for i in range(2):
	clean_list.append([ sorted_surfaces[i][0] , sorted_surfaces[i][0].get_centroid().z() ])
	
final_sort_list = sorted(clean_list, key = lambda x: x[1], reverse = True)

vertices = final_sort_list[0][0].get_vertices ()
top_surface = final_sort_list[0][0].get_surface_geometry()
bottom_surface = final_sort_list[1][0].get_surface_geometry()


#offset_surfaces
#top_surface = top_surface.offset(3.0)
#bottom_surface = bottom_surface.offset(3.0)

"""
test_Cent = final_sort_list[0][0].get_centroid()
sphere = Sphere.by_center_radius (test_Cent, 20.0)

face_points = []
for v in vertices:
	face_points.append(v.get_point_geometry() )
	
test = solid.subtract_from(sphere, True, True, True)
"""
#Assign your output to the OUT variable
OUT = top_surface, bottom_surface
# ----------------------------------------
file_path = StringFilename("C:\dev\Generative-drop-ceiling\Python\panel_boolean_subtraction.py")
read_text_file = FileReader(file_path)
number_slider_2 = DoubleSliderInput(3.687899106, range=0..7)
file_path_2 = StringFilename("C:\dev\Generative-drop-ceiling\Media\mitered_edges.sat")
import_sat = ImportSATNode(file_path_2, lacing=Longest)
watch_4 = Watch(import_sat)
get_from_list_2 = GetFromList(number_slider_2, watch_4)
watch_5 = Watch(get_from_list_2)
python_script_from_string = PythonString(read_text_file, watch_5)
watch_6 = Watch(python_script_from_string)
draw_3 = ForceDrawNode(watch_6, lacing=Longest)
watch_3d_3 = Watch3D(draw_3)
python_script_4 = Python()
# ---------- python_script_4.python (11 lines) ----------
import System
from System import *

rand = Random()
OUT = (rand.Next() % 1000000) / 1000000.0

#The input to this node will be stored in the IN variable.
dataEnteringNode = IN

#Assign your output to the OUT variable
OUT = 0
# ----------------------------------------
python_script_5 = Python(watch_4)
# ---------- python_script_5.python (37 lines) ----------
import sys
path = 'C:\\Users\\t_nguyp\\Desktop\\Dynamo\\Release'
sys.path.append(path)
import clr
clr.AddReference('LibGNet')
from Autodesk.LibG import *

from Autodesk.LibG import Point,Line,Surface,Polygon,Geometry,Vector,Solid

#The input to this node will be stored in the IN variable.
dataEnteringNode = IN

solid_collection = IN


def create_top_bottom_surfaces(solid):
	face_points = []
	vertices = solid.get_vertices()
	for v in vertices:
		face_points.append(v.get_point_geometry() )
	
	surfaces = []
	
	ptlist = PointList([face_points[0], face_points[3], face_points[6], face_points[4] ])
	surfaces.append(Polygon.by_points(ptlist))
	
	ptlist = PointList([face_points[1], face_points[2], face_points[7], face_points[5] ])
	surfaces.append(Polygon.by_points(ptlist))
	
	return surfaces
	
test = []

for solid in solid_collection:
	test.extend(create_top_bottom_surfaces(solid))
	
OUT = test
# ----------------------------------------
watch_7 = Watch(python_script_5)
draw_4 = ForceDrawNode(watch_7, lacing=Longest)
watch_3d_4 = Watch3D(draw_4)
watch_3d_5 = Watch3D(watch_5)
number_slider_3 = DoubleSliderInput(3, range=0..7)
get_from_list_3 = GetFromList(number_slider_3)
