# Dynamo graph surface_subdivide_test_OLD.dyn

number = DoubleInput(0)
point = Point3DNode(number, number, number, lacing=Longest)
file_path = StringFilename("No file selected.")
read_file = FileReader(file_path)
python_script_from_string = PythonString(read_file)
watch = Watch(python_script_from_string)
number_slider = DoubleSliderInput(5.46975547, range=0..10)
number_slider_2 = DoubleSliderInput(3, range=0..10)
list = NewList(index0=number_slider, index1=number_slider_2)
python_script = Python(list)
# ---------- python_script.python (25 lines) ----------
import sys
path = 'C:\\dev\\Dynamo\\bin\\Release'
sys.path.append(path)
import clr
clr.AddReference('LibGNet')
from Autodesk.LibG import *

from Autodesk.LibG import Point,Line,Surface,Polygon,Geometry
#The input to this node will be stored in the IN variable.
dataEnteringNode = IN

x = IN[0]
y = IN[1]

p1 = Point.by_coordinates(0, 0, x)
p2 = Point.by_coordinates(3, 0, 0)
p3 = Point.by_coordinates(3, 3, y)
p4 = Point.by_coordinates(0, 3, 0)

line = []
line.append(Line.by_start_point_end_point (p1,p2))
line.append(Line.by_start_point_end_point(p3,p4))


OUT = line
# ----------------------------------------
loft = LoftNode(python_script, lacing=Longest)
number_slider_3 = DoubleSliderInput(2, range=0..8)
number_slider_4 = DoubleSliderInput(2, range=0..8)
list_2 = NewList(index0=loft, index1=number_slider_3, index2=number_slider_4)
python_script_2 = Python(list_2)
# ---------- python_script_2.python (75 lines) ----------
import sys
path = 'C:\\dev\\Dynamo\\bin\\Release'
sys.path.append(path)
import clr
clr.AddReference('LibGNet')
from Autodesk.LibG import *

from Autodesk.LibG import Point,Line,Surface,Polygon,Geometry
#The input to this node will be stored in the IN variable.
dataEnteringNode = IN

import math

srf = IN[0]
xdiv = IN[1]
ydiv = IN[2]
pt = []

size = xdiv

x = 1/ xdiv
y = 1/ ydiv

xdiv = math.ceil(xdiv)
ydiv = math.ceil(ydiv)


def lowest_point(ptlist):
	count = 0
	for pt in ptlist:
		if count == 0:
			oldZ = pt.z()
			index = count
		if pt.z() <= oldZ:
			#lpt = pt
			oldZ = pt.z()
			index = count
		count += 1
	return index
	
def get_midpt(pt1,pt2):
	
	midPt = [0,0,0]
	
	midPt[0] = (pt1.x() + pt2.x()) /2
	midPt[1] = (pt1.y() + pt2.y()) /2
	midPt[2] = (pt1.z() + pt2.z()) /2
	
	Final_MidPoint = Point.by_coordinates(midPt[0], midPt[1], midPt[2])
	return Final_MidPoint

pt = [[ (i,j) for j in range(int(ydiv)+1)] for i in range(int(xdiv)+1)]

for i in range(int(xdiv)+1):
	for j in range(int(ydiv)+1):
		pt[i][j] = Surface.point_at_parameter(srf, i*x, j*y)
	
collection = []
#sides = []
#for ptcoor in pt:
#	collection.append([ptcoor.x(), ptcoor.y(), ptcoor.z()])

#sqares

for i in range( int(xdiv) ):
	for j in range( int(ydiv) ):
		#0,0 - 1,0 and 0,1 - 1,1
		ptlist = PointList( [ pt[i][j], pt[i+1][j], pt[i+1][j+1], pt[i][j+1] ] )
		#check = lowestPT(ptlist)

                #point_list = PointList( [ ptlist[0], ptlist[1], ptlist[2], ptlist[3] ])
                collection.append(Polygon.by_vertices(ptlist))
				
#Assign your output to the OUT variable
OUT = collection#[collection,sides]
# ----------------------------------------
draw = ForceDrawNode(python_script_2, lacing=Longest)
watch_3d = Watch3D(draw)
file_path_2 = StringFilename("No file selected.")
read_file_2 = FileReader(file_path_2)
python_script_from_string_2 = PythonString(read_file_2)
watch_2 = Watch()
python_script_3 = Python()
# ---------- python_script_3.python (8 lines) ----------
#The input to this node will be stored in the IN variable.
dataEnteringNode = IN

reference_surface = []
reference_surface.extend(IN[1])

#Assign your output to the OUT variable
OUT = reference_surface
# ----------------------------------------
watch_3 = Watch()
watch_4 = Watch(list_2)
list_3 = NewList(index0=loft, index1=python_script_2)
python_script_4 = Python(list_3)
# ---------- python_script_4.python (193 lines) ----------
import sys
path = 'C:\\dev\\Dynamo\\bin\\Release'
sys.path.append(path)
import clr
clr.AddReference('LibGNet')
from Autodesk.LibG import *

from Autodesk.LibG import Point,Line,Surface,Polygon,Geometry
#The input to this node will be stored in the IN variable.
dataEnteringNode = IN

def corner_points(surf):
	"""
	ptlist = [0, 0, 0, 0]
	ptlist[0] = surf.point_at_parameter(0.0, 0.0)
	ptlist[1] = surf.point_at_parameter(1.0, 0.0)
	ptlist[2] = surf.point_at_parameter(1.0, 1.0)
	ptlist[3] = surf.point_at_parameter(0.0, 1.0)
	"""
	polyvert = surf.vertices()
	
	ptlist = []
	for i in range(polyvert.Count):
		ptlist.append(polyvert[i])
		
	return ptlist


def get_midpoint(pt1,pt2):
	
	midPt = [0,0,0]
	
	midPt[0] = (pt1.x() + pt2.x()) /2
	midPt[1] = (pt1.y() + pt2.y()) /2
	midPt[2] = (pt1.z() + pt2.z()) /2
	
	Final_MidPoint = Point.by_coordinates(midPt[0], midPt[1], midPt[2])
	return Final_MidPoint

def add_vector( point, vector, magnitude ):
	vector.normalize()
	
	newpoint = [0,0,0]
	newpoint[0] = point.x() + (vector.x() * magnitude)
	newpoint[1] = point.y() + (vector.y() * magnitude)
	newpoint[2] = point.z() + (vector.z() * magnitude)
	
	finalpt = Point.by_coordinates(newpoint[0], newpoint[1], newpoint[2])
	return finalpt

#not being used
"""
def rotate_points( ptlist ):
	count = 0
	for pt in ptlist:
		if count == 0:
			oldZ = pt.z()
			index = count
		if pt.z() <= oldZ:
			#lpt = pt
			oldZ = pt.z()
			index = count
		count += 1

	#index becomes num of rotation.
	if index > 0:
		for i in range(index):
			last = ptlist.pop()
			ptlist.insert(0,last)
	

	newlist	= [ ptlist[0], ptlist[1], ptlist[2], ptlist[3] ]

	return (newlist)

def planarize_surface (ptlist):
	plane = Plane.by_three_points(ptlist[1], ptlist[2] , ptlist[3])
	ptlist[0] = plane.get_closest_point(ptlist[0])
	
	new_pointlist = PointList( [ ptlist[0], ptlist[1], ptlist[2] , ptlist[3] ] )
	
	return new_pointlist
"""

#needs to be feed correctly
def subdivide_surface( reference_surf, _pointlist ):
	#_pointlist = rotate_points( _pointlist )

	_pointlist.append(_pointlist[0])
	midpts = [0,0,0,0,0]
	for i in range(4):
		midpts[i] = get_midpoint(_pointlist[i], _pointlist[i+1] )
	
	midpts[4] = get_midpoint(midpts[0],midpts[2])
	
	
	#lift points
	
	liftpts = []
	liftmidpts = []

	mag = -0.25
        
	for j in range(5):
	#i might have to replace Surface with srf.normalblahblah
		vec = reference_surf.normal_at_point( _pointlist[j] )
		liftpts.append(add_vector( _pointlist[j], vec , mag ))
		#liftpts.append(_pointlist[j])
		vec = reference_surf.normal_at_point( midpts[j] )
		#liftmidpts.append( midpt[j])
		liftmidpts.append(add_vector( midpts[j], vec, mag ))

	new_surfaces = []
	
	# non lift points
	ptlist = PointList( [  midpts[0], _pointlist[1],  midpts[1],  midpts[4] ] )
	new_surfaces.append(Polygon.by_vertices( ptlist))
	# end of non lift points

	ptlist = PointList([ liftpts[0], liftmidpts[0], liftmidpts[4], liftmidpts[3] ])
	new_surfaces.append( Polygon.by_vertices( ptlist))

	ptlist = PointList([ liftmidpts[3], liftmidpts[4], liftmidpts[2], liftpts[3] ])
	new_surfaces.append( Polygon.by_vertices( ptlist))
	
	ptlist = PointList([ liftmidpts[4], liftmidpts[1], liftpts[2], liftmidpts[2] ])
	new_surfaces.append( Polygon.by_vertices( ptlist))
	

	side = []

	ptlist = PointList([ midpts[4], midpts[0], liftmidpts[0], liftmidpts[4] ])
	side.append( Polygon.by_vertices( ptlist ))
	
	ptlist = PointList([ midpts[1], midpts[4], liftmidpts[4], liftmidpts[1] ])
	side.append( Polygon.by_vertices( ptlist ))

	return [new_surfaces, side]

def output_curves( _FinalSrfs ):
	crvs = []
	for srf in _FinalSrfs:
		pts = corner_points(srf)
		crvs.append([
			Line.by_start_point_end_point(pts[0], pts[1]),
				Line.by_start_point_end_point(pts[3], pts[2])
		])
		
	return crvs

##########################################
iterations = 1

reference_surface = IN[0]
input_surfaces = []
input_surfaces.extend(IN[1])


new_surfaces = []
new_sides = []
surface_points = []


for obj in input_surfaces:
	surface_points.append(corner_points(obj))
	
	
for i in range(len(input_surfaces)):
	#new_surfaces.extend(subdivide_surface( input_surfaces[i], surface_points[i] ))
	#new_surfaces.extend( subdivide_surface( reference_surface, surface_points[i] )[0] )
	temp_surfaces = subdivide_surface( reference_surface, surface_points[i] )
	new_surfaces.extend( temp_surfaces[0] )
	new_sides.extend( temp_surfaces[1] )
	
"""

for j in range(iterations):
	recursive_list = []
	
	for surface in new_surfaces:
		pts = surface_points( surface )
		recursive_list.extend( subdivide_surface( reference_surface, pts ))
		
		new_surfaces = recursive_list
"""

#test_curves = output_curves( new_surfaces )


#Assign your output to the OUT variable
#OUT = test_curves

OUT = [ new_surfaces, new_sides ]
# ----------------------------------------
watch_5 = Watch(python_script_4)
draw_2 = ForceDrawNode(watch_5, lacing=Longest)
watch_3d_2 = Watch3D(draw_2)
list_4 = NewList(index0=loft, index1=watch_5)
python_script_5 = Python()
# ---------- python_script_5.python (147 lines) ----------
#The input to this node will be stored in the IN variable.
dataEnteringNode = IN

def corner_points(surf):
	"""
	ptlist = [0, 0, 0, 0]
	ptlist[0] = surf.point_at_parameter(0.0, 0.0)
	ptlist[1] = surf.point_at_parameter(1.0, 0.0)
	ptlist[2] = surf.point_at_parameter(1.0, 1.0)
	ptlist[3] = surf.point_at_parameter(0.0, 1.0)
	"""
	polyvert = surf.vertices()
	
	ptlist = []
	for i in range(polyvert.Count):
		ptlist.append(polyvert[i])
		
	return ptlist


def get_midpoint(pt1,pt2):
	
	midPt = [0,0,0]
	
	midPt[0] = (pt1.x() + pt2.x()) /2
	midPt[1] = (pt1.y() + pt2.y()) /2
	midPt[2] = (pt1.z() + pt2.z()) /2
	
	Final_MidPoint = Point.by_coordinates(midPt[0], midPt[1], midPt[2])
	return Final_MidPoint

def add_vector( point, vector, magnitude ):
	vector.normalize()
	
	newpoint = [0,0,0]
	newpoint[0] = point.x() + (vector.x() * magnitude)
	newpoint[1] = point.y() + (vector.y() * magnitude)
	newpoint[2] = point.z() + (vector.z() * magnitude)
	
	finalpt = Point.by_coordinates(newpoint[0], newpoint[1], newpoint[2])
	return finalpt

#needs to be feed correctly
def subdivide_surface( reference_surf, _pointlist ):
	_pointlist.append(_pointlist[0])
	midpts = [0,0,0,0,0]
	for i in range(4):
		midpts[i] = get_midpoint(_pointlist[i], _pointlist[i+1] )
	
	midpts[4] = get_midpoint(midpts[0],midpts[2])
	
	#lift points
	
	liftpts = []
	liftmidpts = []

	mag = -0.25
        
	for j in range(5):
	#i might have to replace Surface with srf.normalblahblah
		vec = reference_surf.normal_at_point( _pointlist[j] )
		liftpts.append(add_vector( _pointlist[j], vec , mag ))
		#liftpts.append(_pointlist[j])
		vec = reference_surf.normal_at_point( midpts[j] )
		#liftmidpts.append( midpt[j])
		liftmidpts.append(add_vector( midpts[j], vec, mag ))


	new_surfaces = []
	
	ptlist = PointList( [  midpts[0], _pointlist[1],  midpts[1],  midpts[4] ] )
	new_surfaces.append(Polygon.by_vertices( ptlist))
	

	ptlist = PointList([ liftpts[0], liftmidpts[0], liftmidpts[4], liftmidpts[3] ])
	new_surfaces.append( Polygon.by_vertices( ptlist))

	ptlist = PointList([ liftmidpts[3], liftmidpts[4], liftmidpts[2], liftpts[3] ])
	new_surfaces.append( Polygon.by_vertices( ptlist))
	
	ptlist = PointList([ liftmidpts[4], liftmidpts[1], liftpts[2], liftmidpts[2] ])
	new_surfaces.append( Polygon.by_vertices( ptlist))

	side = []

	ptlist = PointList([ midpts[4], midpts[0], liftmidpts[0], liftmidpts[4] ])
	side.append( Polygon.by_vertices( ptlist ))
	
	ptlist = PointList([ midpts[1], midpts[4], liftmidpts[4], liftmidpts[1] ])
	side.append( Polygon.by_vertices( ptlist ))

	return [new_surfaces, side]

def output_curves( _FinalSrfs ):
	crvs = []
	for srf in _FinalSrfs:
		pts = corner_points(srf)
		crvs.append([
			Line.by_start_point_end_point(pts[0], pts[1]),
				Line.by_start_point_end_point(pts[3], pts[2])
		])
		
	return crvs

##########################################
iterations = 1

reference_surface = IN[0]
input_surfaces = []
input_surfaces.extend(IN[1][0])
new_sides = []
new_sides.extend(IN[1][1])

new_surfaces = []
surface_points = []


for obj in input_surfaces:
	surface_points.append(corner_points(obj))
	
	
for i in range(len(input_surfaces)):
	#new_surfaces.extend(subdivide_surface( input_surfaces[i], surface_points[i] ))
	#new_surfaces.extend( subdivide_surface( reference_surface, surface_points[i] )[0] )
	temp_surfaces = subdivide_surface( reference_surface, surface_points[i] )
	new_surfaces.extend( temp_surfaces[0] )
	new_sides.extend( temp_surfaces[1] )
	
"""

for j in range(iterations):
	recursive_list = []
	
	for surface in new_surfaces:
		pts = surface_points( surface )
		recursive_list.extend( subdivide_surface( reference_surface, pts ))
		
		new_surfaces = recursive_list
"""

#test_curves = output_curves( new_surfaces )


#Assign your output to the OUT variable
#OUT = test_curves

OUT = [ new_surfaces, new_sides ]
# ----------------------------------------
draw_3 = ForceDrawNode(python_script_5, lacing=Longest)
watch_3d_3 = Watch3D(draw_3)
python_script_6 = Python()
# ---------- python_script_6.python (30 lines) ----------
#The input to this node will be stored in the IN variable.
dataEnteringNode = IN

def lowest_point(ptlist):
	count = 0
	for pt in ptlist:
		if count == 0:
			oldZ = pt.z()
			index = count
		if pt.z() <= oldZ:
			#lpt = pt
			oldZ = pt.z()
			index = count
		count += 1
	return index

		check = lowestPT(ptlist)
		
		#check[1] becomes num of rotation.
		if check > 0:
			for k in range(check):
				last = ptlist.pop()
				ptlist.insert(0,last)
			
		plane = Plane.by_three_points(ptlist[1], ptlist[2] , ptlist[3])

		newpt = plane.get_closest_point(ptlist[0])
		
#Assign your output to the OUT variable
OUT = 0
# ----------------------------------------
watch_6 = Watch(python_script)
