# Dynamo graph while_intersect_test.dyn

number = DoubleInput(0)
python_script = Python(number)
# ---------- python_script.python (18 lines) ----------
#The input to this node will be stored in the IN variable.
dataEnteringNode = IN


pt1 = Point.by_coordinates(0.0,0.0,0.0)

pt2 = Point.by_coordinates(0.0,10.0,0.0)

pt3 = Point.by_coordinates(10.0,10.0,0.0)
pt4 = Point.by_coordinates(10.0,0.0,0.0)


poly = Polygon.by_points(PointList([pt1,pt2,pt3,pt4]))

pt1 = Point.by_coordinates(1.0,0.0,10.0)
poly.update_vertices(PointList([pt1,pt2,pt3,pt4]))
#Assign your output to the OUT variable
OUT = poly
# ----------------------------------------
watch = Watch(python_script)
list = NewList(index0=python_script)
draw = ForceDrawNode(list, lacing=Longest)
number_2 = DoubleInput(0)
python_script_2 = Python(python_script)
# ---------- python_script_2.python (37 lines) ----------
#The input to this node will be stored in the IN variable.
dataEnteringNode = IN


def does_intersect(geometry, newpolygon):
	# Geometry.does_intersect(Geometry)
	# four pieces of ceiling geometry
	geo1 = geometry

	is_invalid = geo1.does_intersect(newpolygon)
	return is_invalid
		
def adjust_point(geometry, newpolygon, ptlist, pt1,pt2,pt3,pt4):
	valid = does_intersect(geometry, newpolygon)
	while valid == True:
		pt4.set_z( pt4.z() - 1)
		newptlist = (PointList([pt1,pt2,pt3,pt4]))
		newpolygon.update_vertices(newptlist)
		valid = does_intersect(geometry, newpolygon)
		#move the top_point down until it clears.
	return [valid, newpolygon] 

	
surface = IN

pt1 = Point.by_coordinates(0.0,0.0,-2.0)
pt2 = Point.by_coordinates(0.0,10.0,-2.0)
pt3 = Point.by_coordinates(10.0,10.0,-2.0)
pt4 = Point.by_coordinates(10.0,0.0,5.0)

ptlist = PointList([pt1,pt2,pt3,pt4])
newpolygon = Polygon.by_points(ptlist)

test = adjust_point(surface, newpolygon, ptlist, pt1,pt2,pt3,pt4)

#Assign your output to the OUT variable
OUT = test
# ----------------------------------------
watch_2 = Watch(python_script_2)
list_2 = NewList(index0=python_script_2)
draw_2 = ForceDrawNode(list_2, lacing=Longest)
